# Grasshopper definition british_museum_greate_court_roof.gh (Grasshopper 0.9.76)
# plug-ins: Python Interpreter

# ----
# Figure 3. Function with finite curvature
number_slider = Slider(1, range=-10..40)
number_slider_2 = Slider(-1, range=-10..10)
number_slider_3 = Slider(20, range=0..30)
construct_domain = ConstructDomain(DomainStart=number_slider_2, DomainEnd=number_slider)
construct_domain_2 = ConstructDomain(DomainStart=number_slider_2, DomainEnd=number_slider)
range = Range(Domain=construct_domain, Steps=number_slider_3)
range_2 = Range(Domain=construct_domain_2, Steps=number_slider_3)
cross_reference = CrossReference(ListListA=range, ListListB=range_2, CrossMode=1)  # -> ListListA, ListListB
c_script = CSharpScript(x=cross_reference.ListListA, y=cross_reference.ListListB)  # -> out, A; inputs x: Double, y: Double
# ---------- c_script: C# ----------
    // Constant
    double a = 22.245;
    double b = 36.625;
    double c = 46.025;
    double d = 51.125;
    double ram = 0.5;
    double mu = 14.0;
    double h_cen = 20.955;
    double h_edge = 19.71;

    double r = Math.Sqrt(x * x + y * y);

    double n1 = r / a - 1;
    double n2 = 1 - x / b;
    double n3 = 1 + x / b;
    double n4 = 1 - y / c;
    double n5 = 1 + y / d;
    
    double z = n1 * n2 * n3 * n4 * n5;

    A = z;
# ---------- end c_script ----------
construct_point = ConstructPoint(XCoordinate=cross_reference.ListListA, YCoordinate=cross_reference.ListListB, ZCoordinate=c_script.A)
python_script = PythonScript(pts=construct_point, zs=c_script.A)  # -> out, a; inputs pts: list of Point3d, zs: list
# ---------- python_script: Python ----------
import rhinoscriptsyntax as rs

target_i = -1
alt = rs.AddPoint(0,0,-1)
for i in range(len(pts)):
    pt = pts[i]
    if pt == None:
        print(i)
        target_i = i

pts[target_i] = alt

a= pts
# ---------- end python_script ----------
surface_from_points = SurfaceFromPoints(Points=python_script.a, UCount=Slider(21, range=0..100), Interpolate=False)

# ----
# Figure 2. Level change function
number_slider_4 = Slider(1, range=-10..40)
number_slider_5 = Slider(-1, range=-10..10)
number_slider_6 = Slider(20, range=0..30)
construct_domain_3 = ConstructDomain(DomainStart=number_slider_5, DomainEnd=number_slider_4)
construct_domain_4 = ConstructDomain(DomainStart=number_slider_5, DomainEnd=number_slider_4)
range_3 = Range(Domain=construct_domain_3, Steps=number_slider_6)
range_4 = Range(Domain=construct_domain_4, Steps=number_slider_6)
cross_reference_2 = CrossReference(ListListA=range_3, ListListB=range_4, CrossMode=1)  # -> ListListA, ListListB
c_script_2 = CSharpScript(x=cross_reference_2.ListListA, y=cross_reference_2.ListListB)  # -> out, A; inputs x: Double, y: Double
# ---------- c_script_2: C# ----------
    // Constant
    double a = 22.245;
    double b = 36.625;
    double c = 46.025;
    double d = 51.125;
    double ram = 0.5;
    double mu = 14.0;
    double h_cen = 20.955;
    double h_edge = 19.71;

    double r = Math.Sqrt(x * x + y * y);

   
    double n1 = 1 - x/b;
    double n2 = 1 + x/b;
    double n3 = 1 - y/c;
    double n4 = 1 + y/d;

    double d1 = 1 - a*x/r/b;
    double d2 = 1 + a*x/r/b;
    double d3 = 1 - a*y/r/c;
    double d4 = 1 + a*y/r/d;
    
    double numerator = n1 * n2 * n3 * n4;
    double denominator = d1 * d2 * d3 * d4;

    double z = numerator / denominator;

    //RhinoApp.WriteLine("numerator : " + numerator.ToString());
    //RhinoApp.WriteLine("d1 : " + d1.ToString());
    //RhinoApp.WriteLine("d2 : " + d2.ToString());
    //RhinoApp.WriteLine("d3 : " + d3.ToString());
    //RhinoApp.WriteLine("d4 : " + d4.ToString());

    A = z;
# ---------- end c_script_2 ----------
construct_point_2 = ConstructPoint(XCoordinate=cross_reference_2.ListListA, YCoordinate=cross_reference_2.ListListB, ZCoordinate=c_script_2.A)
python_script_2 = PythonScript(pts=construct_point_2, zs=c_script_2.A)  # -> out, a; inputs pts: list of Point3d, zs: list; same code as python_script
surface_from_points_2 = SurfaceFromPoints(Points=python_script_2.a, UCount=Slider(21, range=0..100), Interpolate=False)

# ----
# Figure 4. Function with conical corners
number_slider_7 = Slider(-1, range=-10..10)
number_slider_8 = Slider(1, range=-10..40)
number_slider_9 = Slider(20, range=0..30)
construct_domain_5 = ConstructDomain(DomainStart=number_slider_7, DomainEnd=number_slider_8)
construct_domain_6 = ConstructDomain(DomainStart=number_slider_7, DomainEnd=number_slider_8)
range_5 = Range(Domain=construct_domain_5, Steps=number_slider_9)
range_6 = Range(Domain=construct_domain_6, Steps=number_slider_9)
cross_reference_3 = CrossReference(ListListA=range_5, ListListB=range_6, CrossMode=1)  # -> ListListA, ListListB
c_script_3 = CSharpScript(x=cross_reference_3.ListListA, y=cross_reference_3.ListListB)  # -> out, A; inputs x: Double, y: Double
# ---------- c_script_3: C# ----------
    // Constant
    double a = 22.245;
    double b = 36.625;
    double c = 46.025;
    double d = 51.125;
    double ram = 0.5;
    double mu = 14.0;
    double h_cen = 20.955;
    double h_edge = 19.71;

    double r = Math.Sqrt(x * x + y * y);

    double numerator = 1 - (a / r);

    double d1 = Math.Sqrt((b - x) * (b - x) + (c - y) * (c - y)) / (b - x) * (c - y);
    double d2 = Math.Sqrt((b - x) * (b - x) + (d + y) * (d + y)) / (b - x) * (d + y);
    double d3 = Math.Sqrt((b + x) * (b + x) + (c - y) * (c - y)) / (b + x) * (c - y);
    double d4 = Math.Sqrt((b + x) * (b + x) + (d + y) * (d + y)) / (b + x) * (d + y);

    double denominator = d1 + d2 + d3 + d4;

    double z = numerator / denominator;

    //RhinoApp.WriteLine("numerator : " + numerator.ToString());
    //RhinoApp.WriteLine("d1 : " + d1.ToString());
    //RhinoApp.WriteLine("d2 : " + d2.ToString());
    //RhinoApp.WriteLine("d3 : " + d3.ToString());
    //RhinoApp.WriteLine("d4 : " + d4.ToString());

    A = z;
# ---------- end c_script_3 ----------
construct_point_3 = ConstructPoint(XCoordinate=cross_reference_3.ListListA, YCoordinate=cross_reference_3.ListListB, ZCoordinate=c_script_3.A)
python_script_3 = PythonScript(pts=construct_point_3, zs=c_script_3.A)  # -> out, a; inputs pts: list of Point3d, zs: list; same code as python_script
surface_from_points_3 = SurfaceFromPoints(Points=python_script_3.a, UCount=Slider(21, range=0..100), Interpolate=False)

# ----
# Result
number_slider_10 = Slider(36, range=-10..100)
number_slider_11 = Slider(48, range=-10..100)
python_script_4 = PythonScript(v=number_slider_10)  # -> a
# ---------- python_script_4: Python ----------
a = -1*v
# ---------- end python_script_4 ----------
python_script_5 = PythonScript(v=number_slider_11)  # -> a; same code as python_script_4
number_slider_12 = Slider(50, range=0..50)
construct_domain_7 = ConstructDomain(DomainStart=python_script_4, DomainEnd=number_slider_10)
construct_domain_8 = ConstructDomain(DomainStart=python_script_5, DomainEnd=number_slider_11)
range_7 = Range(Domain=construct_domain_7, Steps=number_slider_12)
range_8 = Range(Domain=construct_domain_8, Steps=number_slider_12)
addition = Addition(A=number_slider_12, B=Slider(1, range=0..1))
cross_reference_4 = CrossReference(ListListA=range_7, ListListB=range_8, CrossMode=1)  # -> ListListA, ListListB
z = CSharpScript(
    x=cross_reference_4.ListListA,
    y=cross_reference_4.ListListB,
    use_z1=Toggle(True),
    use_z2=Toggle(True),
    use_z3=Toggle(True))  # -> out, A; inputs x: Double, y: Double, use_z1: Boolean, use_z2: Boolean, use_z3: Boolean
# ---------- z: C# ----------
    // Constant

    var roof = new BritishMuseumGreatCourtRoof();
    
    double z1 = roof.GetZ1(x, y);
    double z2 = roof.GetZ2(x, y);
    double z3 = roof.GetZ3(x, y);

    double z = 0;

    if(use_z1)
    {
      z += z1;
    }
    if(use_z2)
    {
      z += z2;
    }
    if(use_z3)
    {
      z += z3;
    }

    A = z;
# ---------- z: C# additional code ----------
 
  public class BritishMuseumGreatCourtRoof
  {
    double a = 22.245;
    double b = 36.625;
    double c = 46.025;
    double d = 51.125;
    double lamd = 0.5;
    double mu = 14.0;
    double h_cen = 20.955;
    double h_edge = 19.71;

    public double GetZ(double x, double y)
    {
      return GetZ1(x, y) + GetZ2(x, y) + GetZ3(x, y);
    }
    
    public double GetZ1(double x, double y)
    {
      double eta = GetETA(x, y);
      double z = (h_cen - h_edge) * eta + h_edge;

      return z;
    }

    public double GetZ2(double x, double y)
    {
      double r = GetR(x, y);
      double alpha = GetALPHA(x, y);
      double psi = GetPSI(x, y);
      double theta = GetTHETA(x, y);
      double tm1 =
        (35.0 + 10.0 * psi) * 1 / 2 * (1 + Math.Cos(2 * theta))
        + 24.0 / 2 * (1 / 2 * (1 - Math.Cos(2 * theta)) + Math.Sin(theta))
        + (7.5 + 12.0 * psi) * (1 / 2 * (1 - Math.Cos(2 * theta)) - Math.Sin(theta))
        - 1.6;

      double tm2 = 10.0 / 2 * (1 + Math.Cos(2 * theta));

      double tm3 =
        10.0 * Math.Pow(1 / 2 * (1 / 2 * (1 - Math.Cos(2 * theta)) + Math.Sin(theta)), 2)
        * (1.0 - 3.0 * alpha);
      ;

      double tm4 =
        2.5
        * Math.Pow(1 / 2 * (1 / 2 * (1 - Math.Cos(2 * theta)) - Math.Sin(theta)), 2)
        * Math.Pow(r / a - 1, 2);

      double z = alpha * ((1 - lamd) * tm1 - tm2 + tm3 + tm4);

      return z;
    }

    public double GetZ3(double x, double y)
    {
      double r = GetR(x, y);
      double beta = GetBETA(x, y);
      double psi = GetPSI(x, y);
      double theta = GetTHETA(x, y);

      double tm1 =
        lamd * ( 3.5 / 2 * ( 1 + Math.Cos(2 * theta))
        + 3.0 / 2 * (1 - Math.Cos(2 * theta))
        + 0.3 * Math.Sin(theta)
        );


      double tm2 =
        1.05 * (
        (Math.Pow(Math.E, -mu * (1 - x / b)) + Math.Pow(Math.E, -mu * (1 + x / b)))
        * (Math.Pow(Math.E, -mu * (1 - y / c)) + Math.Pow(Math.E, -mu * (1 + y / d)))
        );



      double z = beta * (tm1 + tm2);

      return z;
    }

    private double GetTHETA(double x, double y)
    {
      double r = GetR(x, y);

      return Math.Acos(x / r);
    }

    private double GetETA(double x, double y)
    {
      double r = GetR(x, y);

      double n1 = 1 - x / b;
      double n2 = 1 + x / b;
      double n3 = 1 - y / c;
      double n4 = 1 + y / d;

      double d1 = 1 - a * x / r / b;
      double d2 = 1 + a * x / r / b;
      double d3 = 1 - a * y / r / c;
      double d4 = 1 + a * y / r / d;

      double numerator = n1 * n2 * n3 * n4;
      double denominator = d1 * d2 * d3 * d4;

      double eta = numerator / denominator;

      return eta;
    }

    private double GetPSI(double x, double y)
    {
      double n1 = 1 - x / b;
      double n2 = 1 + x / b;
      double n3 = 1 - y / c;
      double n4 = 1 + y / d;

      double psi = n1 * n2 * n3 * n4;

      return psi;
    }

    private double GetR(double x, double y)
    {
      double r = Math.Sqrt(x * x + y * y);

      return r;
    }

    private double GetALPHA(double x, double y)
    {
      double psi = GetPSI(x, y);
      double r = GetR(x, y);

      double alpha = (r / a - 1) * psi;

      return alpha;
    }

    private double GetBETA(double x, double y)
    {
      double r = GetR(x, y);

      double numerator = 1 - (a / r);

      double d1 = Math.Sqrt((b - x) * (b - x) + (c - y) * (c - y)) / (b - x) / (c - y);
      double d2 = Math.Sqrt((b - x) * (b - x) + (d + y) * (d + y)) / (b - x) / (d + y);
      double d3 = Math.Sqrt((b + x) * (b + x) + (c - y) * (c - y)) / (b + x) / (c - y);
      double d4 = Math.Sqrt((b + x) * (b + x) + (d + y) * (d + y)) / (b + x) / (d + y);

      double denominator = d1 + d2 + d3 + d4;

      double z = numerator / denominator;

      return z;
    }
    
  }
# ---------- end z ----------
construct_point_4 = ConstructPoint(XCoordinate=cross_reference_4.ListListA, YCoordinate=cross_reference_4.ListListB, ZCoordinate=z.A)
python_script_6 = PythonScript(pts=construct_point_4)  # -> out, pts; inputs pts: list of Point3d
# ---------- python_script_6: Python ----------
import rhinoscriptsyntax as rs

target_i = -1

for i in range(len(pts)):
    pt = pts[i]
    if pt == None:
        print(i)
        target_i = i

valids = filter(lambda v: v != None, pts)
zs = map(lambda v: v.Z, valids)
alt = rs.AddPoint(0,0,min(zs))

pts[target_i] = alt

a= pts
# ---------- end python_script_6 ----------
surface_from_points_4 = SurfaceFromPoints(Points=python_script_6.pts, UCount=addition, Interpolate=False)

# ----
# Alt1
number_slider_13 = Slider(19.71, range=0..100)
z_2 = CSharpScript(
    x=cross_reference_4.ListListA,
    y=cross_reference_4.ListListB,
    a=number_slider_13,
    b=Slider(30.788, range=0..100),
    c=Slider(58.518, range=0..100),
    d=Slider(55.221, range=0..100),
    lamd=Slider(0.7, range=0..1),
    mu=Slider(1.7, range=0..100),
    h_cen=Slider(10.715, range=0..100),
    h_edge=Slider(45.92, range=0..100))  # -> out, A; inputs x: Double, y: Double, a: Double, b: Double, c: Double, d: Double, lamd: Double, mu: Double, h_cen: Double, h_edge: Double
# ---------- z_2: C# ----------
     a = _a;
     b = _b;
     c = _c;
     d = _d;
     lamd = _lamd;
     mu = _mu;
     h_cen = _h_cen;
     h_edge = _h_edge;
    
    double z1 = GetZ1(x, y);
    double z2 = GetZ2(x, y);
    double z3 = GetZ3(x, y);


    double z = z1 + z2 + z3;

    //RhinoApp.WriteLine("numerator : " + numerator.ToString());
    //RhinoApp.WriteLine("d1 : " + d1.ToString());
    //RhinoApp.WriteLine("d2 : " + d2.ToString());
    //RhinoApp.WriteLine("d3 : " + d3.ToString());
    //RhinoApp.WriteLine("d4 : " + d4.ToString());

    A = z;
# ---------- z_2: C# additional code ----------
  double a = 22.245;
  double b = 36.625;
  double c = 46.025;
  double d = 51.125;
  double lamd = 0.5;
  double mu = 14.0;
  double h_cen = 20.955;
  double h_edge = 19.71;

  public double GetZ1(double x, double y)
  {
    double eta = GetETA(x, y);
    double z = (h_cen - h_edge) * eta + h_edge;

    return z;
  }

  public double GetZ2(double x, double y)
  {
    double r = GetR(x, y);
    double alpha = GetALPHA(x, y);
    double psi = GetPSI(x, y);
    double theta = GetTHETA(x, y);
    double tm1 =
      (35.0 + 10.0 * psi) * 1 / 2 * (1 + Math.Cos(2 * theta))
      + 24.0 / 2 * (1 / 2 * (1 - Math.Cos(2 * theta)) + Math.Sin(theta))
      + (7.5 + 12.0 * psi) * (1 / 2 * (1 - Math.Cos(2 * theta)) - Math.Sin(theta))
      - 1.6;

    double tm2 = 10.0 / 2 * (1 + Math.Cos(2 * theta));

    double tm3 =
      10.0 * Math.Pow(1 / 2 * (1 / 2 * (1 - Math.Cos(2 * theta)) + Math.Sin(theta)), 2)
      * (1.0 - 3.0 * alpha);
    ;

    double tm4 =
      2.5
      * Math.Pow(1 / 2 * (1 / 2 * (1 - Math.Cos(2 * theta)) - Math.Sin(theta)), 2)
      * Math.Pow(r / a - 1, 2);

    double z = alpha * ((1 - lamd) * tm1 - tm2 + tm3 + tm4);

    return z;
  }

  public double GetZ3(double x, double y)
  {
    double r = GetR(x, y);
    double beta = GetBETA(x, y);
    double psi = GetPSI(x, y);
    double theta = GetTHETA(x, y);

    double tm1 =
      lamd * ( 3.5 / 2 * ( 1 + Math.Cos(2 * theta))
      + 3.0 / 2 * (1 - Math.Cos(2 * theta))
      + 0.3 * Math.Sin(theta)
      );


    double tm2 =
      1.05 * (
      (Math.Pow(Math.E, -mu * (1 - x / b)) + Math.Pow(Math.E, -mu * (1 + x / b)))
      * (Math.Pow(Math.E, -mu * (1 - y / c)) + Math.Pow(Math.E, -mu * (1 + y / d)))
      );



    double z = beta * (tm1 + tm2);

    return z;
  }

  public double GetTHETA(double x, double y)
  {
    double r = GetR(x, y);

    return Math.Acos(x / r);
  }

  public double GetETA(double x, double y)
  {
    double r = GetR(x, y);

    double n1 = 1 - x / b;
    double n2 = 1 + x / b;
    double n3 = 1 - y / c;
    double n4 = 1 + y / d;

    double d1 = 1 - a * x / r / b;
    double d2 = 1 + a * x / r / b;
    double d3 = 1 - a * y / r / c;
    double d4 = 1 + a * y / r / d;

    double numerator = n1 * n2 * n3 * n4;
    double denominator = d1 * d2 * d3 * d4;

    double eta = numerator / denominator;

    return eta;
  }

  public double GetPSI(double x, double y)
  {
    double n1 = 1 - x / b;
    double n2 = 1 + x / b;
    double n3 = 1 - y / c;
    double n4 = 1 + y / d;

    double psi = n1 * n2 * n3 * n4;

    return psi;
  }

  public double GetR(double x, double y)
  {
    double r = Math.Sqrt(x * x + y * y);

    return r;
  }

  public double GetALPHA(double x, double y)
  {
    double psi = GetPSI(x, y);
    double r = GetR(x, y);

    double alpha = (r / a - 1) * psi;

    return alpha;
  }

  public double GetBETA(double x, double y)
  {
    double r = GetR(x, y);

    double numerator = 1 - (a / r);

    double d1 = Math.Sqrt((b - x) * (b - x) + (c - y) * (c - y)) / (b - x) / (c - y);
    double d2 = Math.Sqrt((b - x) * (b - x) + (d + y) * (d + y)) / (b - x) / (d + y);
    double d3 = Math.Sqrt((b + x) * (b + x) + (c - y) * (c - y)) / (b + x) / (c - y);
    double d4 = Math.Sqrt((b + x) * (b + x) + (d + y) * (d + y)) / (b + x) / (d + y);

    double denominator = d1 + d2 + d3 + d4;

    double z = numerator / denominator;

    return z;
  }
# ---------- end z_2 ----------
construct_point_5 = ConstructPoint(XCoordinate=cross_reference_4.ListListA, YCoordinate=cross_reference_4.ListListB, ZCoordinate=z_2.A)

python_script_7 = PythonScript(pts=construct_point_5)  # -> out, pts; inputs pts: list of Point3d; same code as python_script_6
python = PythonScript(pts=python_script_7.pts, ptlen=addition)  # -> out, lns; inputs pts: list, ptlen: Int32
# ---------- python: Python ----------
import rhinoscriptsyntax as rs

lns = []

for i in range(ptlen-1):
    for j in range(ptlen-1):
        
        base = ptlen*i+j
        
        pt1 = pts[base]
        pt2 = pts[base+1]
        pt3 = pts[base+ptlen]
        pt4 = pts[base+ptlen+1]
        
        ln1 = rs.AddLine(pt1,pt4)
        ln2 = rs.AddLine(pt2,pt3)
        lns.append(ln1)
        lns.append(ln2)
# ---------- end python ----------
python_2 = PythonScript(pts=python_script_6.pts, ptlen=addition)  # -> out, lns; inputs pts: list, ptlen: Int32; same code as python
points = PointList(Points=python_script_6.pts, Size=Slider(0.8, range=0..10))
